vi "index.gviweb"   [G Web Development Software 22.3.0]
panel controls:
  "Fd": f64 = 5
  "Fc": f64 = 5
  "forstyrrelse Fd": bool = TRUE
  "Pause": bool
  "P-REGULATOR": bool
  "SKAL-verdi": f64 = 50
  "Kp": f64 = 0.5
  "milliseconds to wait": u32 = 250
panel indicators:
  "Trendkurver for nivå": cluster{"Element 1": f64, "Element 2": f64}
  "Tank": f64
  "Fut": f64
  "Trendkurver for prosesstrømmer": T1
  "Er verdi": f64
  "F_c": f64
  "F_d": f64
  "Poeng:": i32
  "Reguleringsavvik": f64
  "teller": i32
  "stopp": bool
types:
  T1 = cluster{"Element 1": f64, "Element 2": f64, "Element 3": f64}
diagram:
  s1 = 50  # shift register
  s2 = 0  # shift register
  s3 = 0  # shift register
  while {
    Build Cluster(s1, $"SKAL-verdi") -> w1
    $"Trendkurver for nivå" <- w1
    Subtract(x=$"SKAL-verdi", y=$"Er verdi") -> w2
    $Reguleringsavvik <- w2
    $Tank <- s1
    In Range And Coerce(lower limit=0, upper limit=10, x=$Fc) -> (coerced(x)=w3)
    Build Cluster($Fd, w3, $Fut) -> w4
    $"Trendkurver for prosesstrømmer" <- w4
    Add($Fd, w3) -> w5
    Subtract(x=w5, y=$Fut) -> w6
    Add(w6, s1) -> w7
    In Range And Coerce(lower limit=0, upper limit=100, x=w7) -> (coerced(x)=w8)
    Is Less(x=w8, y=20) -> w9
    case (w9) {
      frame False, Default { }
      frame True {
        Number To Decimal String(number=$"Poeng:") -> (decimal integer string=w10)
        Concatenate Strings("tanken er tom!", "\n", "Gamer pover!!!!", "\n", "Du fikk  ", w10, " poeng.") -> w11
        One Button Dialog(message=w11) -> (true=w12)
        $stopp <- w12
      }
    }
    $F_d <- $Fd
    $F_c <- w3
    Is Greater(x=w8, y=80) -> w13
    case (w13) {
      frame False, Default { }
      frame True {
        One Button Dialog(message="tanken er full! Game over") -> (true=w14)
        $stopp <- w14
      }
    }
    $"Er verdi" <- w8
    Square Root(x=s1) -> w15
    Square Root(x=2) -> w16
    Multiply(w15, w16) -> w17
    $Fut <- w17
    case ($"forstyrrelse Fd") {
      frame False, Default {
        w18 = 0
      }
      frame True {
        Increment(x=s2) -> w19
        Is Greater(x=w19, y=40) -> w20
        Select(s=w20, t=0, f=w19) -> w18
        Is Less(x=s2, y=1) -> w21
        case (w21) {
          frame False, Default { }
          frame True {
            Random Number() -> (number (0 to 1)=w22)
            Multiply(w22, 10) -> w23
            $Fd <- w23
          }
        }
      }
    }
    case ($Pause) {
      frame False, Default { }
      frame True {
        while {
          Not(x=$Pause) -> w24
          stop if w24
        }
      }
    }
    case ($"P-REGULATOR") {
      frame False, Default { }
      frame True {
        Subtract(x=$"SKAL-verdi", y=$"Er verdi") -> w25
        Multiply(w25, $Kp) -> w26
        $Fc <- w26
      }
    }
    Add(s3, 1) -> w27
    Absolute Value(x=$Reguleringsavvik) -> w28
    Is Greater(x=w28, y=20) -> w29
    case (w29) {
      frame False, Default {
        w30 = w27
      }
      frame True {
        Subtract(x=w27, y=50) -> w30
      }
    }
    $"Poeng:" <- s3
    Logical Or($stopp, FALSE) -> w31
    Wait(time to wait=$"milliseconds to wait")
    Multiply(50, $teller) -> w32
    Is Greater(x=$"Poeng:", y=w32) -> w33
    case (w33) {
      frame False, Default { }
      frame True {
        Increment(x=$teller) -> w34
        $teller <- w34
        Subtract(x=$"milliseconds to wait", y=50) -> w35
        Is Less(x=w35, y=50) -> w36
        Select(s=w36, t=50, f=w35) -> w37
        $"milliseconds to wait" <- w37
      }
    }
    next s1 = w8
    next s2 = w18
    next s3 = w30
    stop if w31
  }
  $teller <- 1
  $"milliseconds to wait" <- 250
